# Grasshopper definition 230803_CAE_design_tool.ghx (Grasshopper 1.0.7)
# plug-ins: MeshEdit Components

reload = Button()  # disabled
py = PythonScript(reload=reload)  # disabled
# ---------- py: Python ----------
from compas_rhino.utilities.misc import get_tolerance
from compas_rhino.utilities.misc import unload_modules

from compas_ghpython import unload_modules

unload_modules("compas")
unload_modules("compas_fab")
unload_modules("ur_fabrication_control")
unload_modules("assembly_information_model")
unload_modules("am_information_model") 
unload_modules("window_in_wall")
# ---------- end py ----------

panel = Panel("Reload libraries")
bang = Button()
unload = PythonScript(reload=bang)
# ---------- unload: Python ----------
from compas_ghpython import unload_modules

if reload:
    #unload_modules('climate_aware_robotic_envelope')
    #unload_modules('assembly_information_model')
    #unload_modules('robotic_brick_envelope')
    unload_modules('climate_active_envelopes')
# ---------- end unload ----------

ghpython_script = GhPythonScript()  # -> out, a; disabled
# ---------- ghpython_script: Python ----------
__author__ = "Bootsy"
__version__ = "2023.04.27"

import rhinoscriptsyntax as rs

                """
                if j == 0: #first planes
                    z1.Rotate(m.radians(90), plane.ZAxis)
                    z1.Translate(z1.XAxis*-(width/2 + mortar))
                    z1.Translate(z1.YAxis*-(width/2 + mortar))
                    
                if j == len(planes)-1: #last planes
                    z1_copy = rg.Plane(z1)
                    z1_copy.Rotate(m.radians(90), z1_copy.ZAxis)
                    z1_copy.Translate(z1_copy.YAxis*-(width+width/2+mortar*2))
                    z1_copy.Translate(z1_copy.XAxis*-(width/2 + mortar))
                    row.append(z1_copy)
                """
# ---------- end ghpython_script ----------

# ---- group: globals
elem_ins = Mesh(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)
design_globals = GhPythonScript(init=Button(), width="0.115", height="0.071", length="0.24", mortar="0.01", elem_ins=elem_ins)  # -> assembly; inputs elem_ins: Mesh
# ---------- design_globals: Python ----------
from compas.geometry import Frame, Polygon, Plane
from compas.datastructures import Mesh
#from climate_aware_robotic_envelope.assembly import Element, Assembly

from climate_active_envelopes.assembly import BRICK_Assembly as Assembly

from compas_ghpython.artists import Artist

assembly = Assembly()

assembly.set_attribute('width', width)
assembly.set_attribute('height', height)
assembly.set_attribute('length', length)
assembly.set_attribute('mortar', mortar)
assembly.set_attribute('elem_ins', elem_ins)
# ---------- end design_globals ----------

# ---- group: draw element
show = BooleanToggle(False)
show_2 = BooleanToggle(False)
elem_def = GhPythonScript(assembly=design_globals)  # -> assembly, elem_full, elem_ins
# ---------- elem_def: Python ----------
from compas.geometry import Frame
from compas_rhino.geometry import RhinoMesh
from compas.datastructures import Mesh
from compas.artists import Artist
from climate_active_envelopes.assembly import BRICK_Assembly as Assembly
from climate_active_envelopes.assembly import CAEElement as Element
import Rhino.Geometry as rg


# dimensions full brick
length = assembly.get_attribute('length')
width = assembly.get_attribute('width')
height = assembly.get_attribute('height')
elem_ins = assembly.get_attribute('elem_ins')


elem_full = Element.from_dimensions(length, width, height)
elem_full.tool_frame = Frame([0, 0, height], [1, 0, 0], [0, -1, 0])


elem_ins = Element.from_rhinomesh_geometry(elem_ins, Frame([0, 0, height/2], [1, 0, 0], [0, -1, 0]))
elem_ins.tool_frame = Frame([0, 0, height], [1, 0, 0], [0, -1, 0])

print elem_ins
print elem_full
# ---------- end elem_def ----------
draw = PythonScript(elem_full=elem_def.elem_full, elem_ins=elem_def.elem_ins, show_full=show_2, show_ins=show)  # -> M, F, S
# ---------- draw: Python ----------
from compas.artists import Artist


#M = Artist(elem_ins.mesh).draw()
#print M

if show_full:
    M = Artist(elem_full.mesh).draw()
    F = Artist(elem_full.frame).draw()
    S = Artist(elem_full.tool_frame).draw()


if show_ins:
    M = Artist(elem_ins.mesh).draw()
    F = Artist(elem_ins.frame).draw()
    S = Artist(elem_ins.tool_frame).draw()
# ---------- end draw ----------
plane = Plane(draw.F)
mesh = Mesh(draw.M)
plane_2 = Plane(draw.S)

# ----
py_2 = PythonScript()  # -> HERE, DATA
# ---------- py_2: Python ----------
import os

HERE = os.path.dirname(ghdoc.Path)
DATA = os.path.abspath(os.path.join(HERE, "..", "data"))

#print(HERE)
#print(DATA)
# ---------- end py_2 ----------

# ---- group: wall_mesh
global_wall = GhPythonScript(assembly=elem_def.assembly, wall_length=Slider(3, range=0.4..10), wall_height=Slider(0.5, range=0.3..10))  # -> assembly, mesh_wall, mesh_grid
# ---------- global_wall: Python ----------
from compas.datastructures import Mesh
from compas.geometry import Curve, Point, Frame
from compas.artists import MeshArtist, Artist
import math as m
import Rhino.Geometry as rg
from compas.utilities import normalize_values

length = assembly.get_attribute('length')
height = assembly.get_attribute('height')
width = assembly.get_attribute('width')
mortar = assembly.get_attribute('mortar')


mesh_wall = Mesh()
mesh_wall_left = Mesh()
mesh_wall_right = Mesh()

mesh_grid = []
mesh_grid_left = []
mesh_grid_right = []

step_in_z = height + mortar/2
step_in_x = (length+width)/2 + mortar
vertices_per_row = int(wall_length / step_in_x)

vertices_per_row_2 = int((wall_length*1.2) / step_in_x)
row = int(wall_height / step_in_z)
#interval = period/vertices_per_row

total_length = (vertices_per_row - 1) * (step_in_x)


#create vertices
for j in range(row): 
    z = j * step_in_z
    for i in range(vertices_per_row): 
        y = 0
        x = i * step_in_x
        mesh_wall.add_vertex(x = x, y = y, z = z) 

#create faces
for j in range(row -1):
    planes_per_row = []
    for i in range(vertices_per_row - 1):
        a = i + j * vertices_per_row
        b = a + vertices_per_row
        c = b + 1
        d = a + 1

#create planes at faces_centroid
        vertex_centroid = mesh_wall.face_centroid(mesh_wall.add_face([a, b, c, d]))
        vertex_pts = Point(vertex_centroid[0], vertex_centroid[1], vertex_centroid[2])
        vertex_frame = Frame([vertex_pts[0], vertex_pts[1], vertex_pts[2]], [1,0,0], [0,1,0])
        vertex_plane = Artist(vertex_frame).draw()
        planes_per_row.append(vertex_plane)
    mesh_grid.append(planes_per_row)

face_cplanes = [plane for planes_row in mesh_grid for plane in planes_row]



























"""
if add_left:
    # create vertices
    for j in range(row): 
        z = j * step_in_z
        for i in range(vertices_per_row_2): 
            y = i * step_in_x
            x = 0
            mesh_wall_left.add_vertex(x = x, y = y, z = z) 
            #V2 = MeshArtist(mesh_wall_left).draw_vertices()
            
    #create faces
    for j in range(row - 1):
        planes_per_row_2 = []
        for i in range(vertices_per_row_2 - 1):
            e = i + j * vertices_per_row_2
            f = e + vertices_per_row_2
            g = f + 1
            h = e + 1
            #mesh_wall_left.add_face([e, f, g, h])
            #M2 = MeshArtist(mesh_wall_left).draw()

    #create planes at faces_centroid
            vertex_centroid_2 = mesh_wall_left.face_centroid(mesh_wall_left.add_face([e, f, g, h]))
            vertex_cpts_2 = Point(vertex_centroid_2[0], vertex_centroid_2[1], vertex_centroid_2[2])
            vertex_cframe_2 = Frame([vertex_cpts_2[0], vertex_cpts_2[1], vertex_cpts_2[2]], [1,0,0], [0,1,0])
            vertex_cplane_2 = Artist(vertex_cframe_2).draw()
            planes_per_row_2.append(vertex_cplane_2)
        mesh_grid_left.append(planes_per_row_2)

    face_cplanes_2 = [plane_2 for planes_row_2 in mesh_grid_left for plane_2 in planes_row_2]




if add_right:
    # create vertices
    for j in range(row): 
        z = j * step_in_z
        for i in range(vertices_per_row_2): 
            y = i * step_in_x
            x = (total_length)
            mesh_wall_right.add_vertex(x = x, y = y, z = z) 


    #create faces
    for j in range(row - 1):
        planes_per_row_2 = []
        for i in range(vertices_per_row_2 - 1):
            k = i + j * vertices_per_row_2
            l = k + vertices_per_row_2
            m = l + 1
            n = k + 1

    #create planes at faces_centroid
            vertex_centroid_3 = mesh_wall_right.face_centroid(mesh_wall_right.add_face([k, l, m, n]))
            vertex_cpts_3 = Point(vertex_centroid_3[0], vertex_centroid_3[1], vertex_centroid_3[2])
            vertex_cframe_3 = Frame([vertex_cpts_3[0], vertex_cpts_3[1], vertex_cpts_3[2]], [1,0,0], [0,1,0])
            vertex_cplane_3 = Artist(vertex_cframe_3).draw()
            planes_per_row_2.append(vertex_cplane_3)
        mesh_grid_right.append(planes_per_row_2)

    face_cplanes_2 = [plane_3 for planes_row_3 in mesh_grid_right for plane_3 in planes_row_3]
    
    
#mesh_wall_all = []
#mesh_wall_all += mesh_wall, mesh_wall_left, mesh_wall_right


## Create wall curves left and right
#total_length = step_in_x*(vertices_per_row-1)
#total_height = step_in_z*(row-1)

#wall_crv_left = rg.Line(rg.Point3d(0,0,0), rg.Point3d(0,0,total_height))
#wall_crv_bottom_left = rg.Line(rg.Point3d(0,0,0), rg.Point3d(0, m.pi*0.5, 0))

#wall_crv_right = rg.Line(rg.Point3d(total_length,0,0), rg.Point3d(total_length, 0, total_height))
#wall_crv_bottom_right = rg.Line(rg.Point3d(total_length,0,0), rg.Point3d(total_length, m.pi*0.5, 0))



#        if add_front:
#            x = i * step_in_x
#            y = amplitude * m.sin(interval * i + phase)
#            mesh_wall.add_vertex(x=x, y=y, z=z)
#
#        if add_left:
#            x = 0
#            y = i * step_in_x
#            mesh_wall.add_vertex(x=x, y=y, z=z)
#
#        if add_right:
#            y = i * step_in_x
#            x = total_length
#            mesh_wall.add_vertex(x=x, y=y, z=z)
"""
# ---------- end global_wall ----------

show_3 = BooleanToggle(True)
show_4 = BooleanToggle(False)
show_5 = BooleanToggle(False)
draw_2 = PythonScript(mesh_wall=global_wall.mesh_wall, show_faces=show_3, show_vertices=show_4, show_labels=show_5)  # -> M, V, L
# ---------- draw_2: Python ----------
from compas.artists import Artist, MeshArtist, artist
import Rhino.Geometry as rg

meshes = []
vertices = []
labels = []

if show_faces:
    M = MeshArtist(mesh_wall).draw()
    #M_left = MeshArtist(mesh_wall_left).draw()
    #M_right = MeshArtist(mesh_wall_right).draw()

if show_vertices:
    V = MeshArtist(mesh_wall).draw_vertices()
    #V_left = MeshArtist(mesh_wall_left).draw_vertices()
    #V_right = MeshArtist(mesh_wall_right).draw_vertices()

if show_labels:
    L = [key for key in mesh_wall.vertices()]
    #L_left = [key for key in mesh_wall_left.vertices()]
    #L_right = [key for key in mesh_wall_right.vertices()]


    meshes = M
# ---------- end draw_2 ----------
swatch = ColourSwatch(SwatchColor=RGB(0, 0, 0))

# ----
mesh_2 = Mesh(draw_2.M)
text_tag = TextTag(Location=draw_2.V, Text=draw_2.L, Colour=swatch)
point = Point(draw_2.V)
plane_grid = GhPythonScript(assembly=global_wall.assembly, mesh_grid=global_wall.mesh_grid)  # -> assembly, plane_grid; inputs mesh_grid: list
# ---------- plane_grid: Python ----------
from compas.geometry import Curve, Point, Frame
from compas.artists import Artist, artist
import math as m
import Rhino.Geometry as rg

length = assembly.get_attribute('length')
height = assembly.get_attribute('height')
width = assembly.get_attribute('width')
mortar = assembly.get_attribute('mortar')


plane_grid = []

def create_plane_grid(mesh_grid):

    for i, row_planes in enumerate(mesh_grid):
        row = []
        for j, plane in enumerate(row_planes):
            z1 = plane
            z1.Translate(z1.ZAxis*-height/2)


            #odd layers
            if i%2 == 0: 
                if j%2 == 0: 
                    z1.Translate(z1.YAxis*+(length/4 + mortar/4))
                    z1.Rotate(m.radians(90), z1.ZAxis)
                    z4 = rg.Plane(z1)
                    z4.Translate(z4.XAxis*+(length + mortar))
                    row.append(z4)

                if j%2 == 1:
                    z2 = rg.Plane(z1)
                    z2.Rotate(m.radians(90), z2.ZAxis)
                    z2.Translate(z2.YAxis*+(width/2 + mortar/2))
                    z2.Translate(z2.XAxis*+((length/2+width/2) + mortar))
                    row.append(z2)
                    z3 = rg.Plane(z2)
                    z2.Translate(z2.YAxis*-(width + mortar))
                    row.append(z3)
                    z5 = rg.Plane(z1)
                    z5.Translate(z5.YAxis*+((length+ width) + mortar*2))
                    row.append(z5)


            #even layers
            if i%2 == 1:
                if j%2 == 1:
                    z1.Translate(z1.YAxis*+(length/4 + mortar/4))
                    z1.Rotate(m.radians(90), z1.ZAxis)
                    z4 = rg.Plane(z1)
                    z4.Translate(z4.XAxis*+(length + mortar))
                    row.append(z4)

                if j%2 == 0:
                    z2 = rg.Plane(z1)
                    z2.Rotate(m.radians(90), z2.ZAxis)
                    z2.Translate(z2.YAxis*+(width/2 + mortar/2))
                    z2.Translate(z2.XAxis*+((length/2+width/2) + mortar))
                    row.append(z2)
                    z3 = rg.Plane(z2)
                    z2.Translate(z2.YAxis*-(width + mortar))
                    row.append(z3)
                    z5 = rg.Plane(z1)
                    z5.Translate(z5.YAxis*+((length+ width) + mortar*2))
                    row.append(z5)

            row.append(z1)

            
        plane_grid.append(row)
    return plane_grid

plane_grid = create_plane_grid(mesh_grid)


def list_from_2darray(array):
    return [item for sublist in array for item in sublist]

planes = list_from_2darray(plane_grid)
# ---------- end plane_grid ----------
transformation = GhPythonScript(
    plane_grid=plane_grid.plane_grid,
    mesh_wall=global_wall.mesh_wall,
    transf_values=[627, 628, 563, 471, 463, 434, 407, 380, 358, 402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])  # -> t_pts, params_grid; inputs plane_grid: list, transf_values: list
# ---------- transformation: Python ----------
import Rhino.Geometry as rg
from compas.utilities import normalize_values
from compas.geometry import Curve, Point, Frame


# create list of face_centroids
c_pts = []
for j, face in enumerate(mesh_wall.faces()):
    vertex_centroid = mesh_wall.face_centroid(face)
    points = rg.Point3d(vertex_centroid[0],vertex_centroid[1], vertex_centroid[2])
    c_pts.append(points)

#normalize values from the simulation
transf_values = normalize_values(transf_values, -1.0, 0.0)
params_grid = []

# create new planes / points from transf_values
t_pts = []
t_pls = []
for i, points in enumerate(c_pts):
    x = points[0]
    z = points[2]
    y = transf_values[i]
    t_pt = rg.Point3d(x,y,z)
    t_pts.append(t_pt)
    # create planes from points
    t_pl = rg.Plane(rg.Point3d(x,y,z), rg.Vector3d(1, 0, 0), rg.Vector3d(0, 1, 0))
    t_pls.append(t_pl)

"""
    planes = plane_grid[i]


    for j, plane in enumerate(planes):
        params = {
            'plane': plane,
            't_pt': t_pts[i],
            't_pl': t_pls[i],
            'dist': t_pts[i] - c_pts[i]
        }
        params_grid.append(params)

params_list = []
for i,row in enumerate(params_grid):
    print i
    for j, params_list in enumerate(row):
        pass

"""



    #print i, row
    #for j, params_list in enumerate(row):
        #print params_list

#def translate_points(c_pts, t_vecs):
#    translated_points = []
#    for c_pt, t_vec in zip(c_pts, t_vecs):
#        translated_point = rg.Point3d.Add(c_pt, t_vec)
#        translated_points.append(translated_point)
#    return translated_points
#
#points = translate_points(c_pts, t_vecs)

#points = translate_points(c_pts, t_vecs)
# ---------- end transformation ----------
point_2 = Point(transformation.t_pts)

# ---- group: assembly structure
transf = BooleanToggle(False)
assembly = GhPythonScript(
    assembly=plane_grid.assembly,
    t_pts=transformation.t_pts,
    generate=Button(),
    transform=transf,
    plane_grid=plane_grid.plane_grid,
    params_grid=transformation.params_grid,
    elem_full=elem_def.elem_full,
    elem_ins=elem_def.elem_ins)  # -> assembly; inputs t_pts: list of Point3d, plane_grid: list, params_grid: list
# ---------- assembly: Python ----------
import Rhino.Geometry as rg
import math as m
from compas.geometry import Frame, Point, Rotation, Transformation, Translation
from compas.utilities import normalize_values
#from climate_aware_robotic_envelope.assembly import Assembly

#from climate_active_envelopes.assembly import BRICK_Assembly as Assembly


length = assembly.get_attribute('length')
height = assembly.get_attribute('height')
width = assembly.get_attribute('width')
mortar = assembly.get_attribute('mortar')

"""
c_pts = []
for j, face in enumerate(mesh_wall.faces()):
    vertex_centroid = mesh_wall.face_centroid(face)
    points = rg.Point3d(vertex_centroid[0],vertex_centroid[1], vertex_centroid[2])
    c_pts.append(points)

for i, points in enumerate(c_pts):
    transf_values = normalize_values(transf_values, -0.10, 0.0)
    t_val = transf_values[i]
    t_pl = rg.Plane(rg.Point3d(points[0],t_val,points[2]), rg.Vector3d(1, 0, 0), rg.Vector3d(0, 1, 0))
    t_frame = Frame(t_pl.Origin, t_pl.XAxis, t_pl.YAxis)
"""
if generate:
    for i, row in enumerate(plane_grid): # number of layers and all planes
        for j, plane in enumerate(row): #j = planes / layer
            frame = Frame(plane.Origin, plane.XAxis, plane.YAxis)
            frame_pt = frame.point

            if transform == True:
                for t_pt in t_pts:
                    dist =  t_pt.DistanceTo(rg.Point3d(frame.point[0], frame.point[1], frame.point[2]))

                if i%2 == 0 and j%3 == 1 and j%2 == 1:
                    plane.Translate(plane.XAxis*-m.radians(dist*2))

                if i%2 == 1  and j%3 != 0 and j%3 != 1 and j%2 == 1:
                    plane.Translate(plane.XAxis*-m.radians(dist*2))
                T = Transformation.from_frame_to_frame(Frame.worldXY(), Frame(plane.Origin, plane.XAxis, plane.YAxis))
            else: 
                T = Transformation.from_frame_to_frame(Frame.worldXY(), frame)


            if i%2 == 1 and j%2 == 1 and j%3 != 1:
                c = elem_full.transformed(T)
                assembly.add_element(c)
            elif i%2 == 0 and j%2 == 1 and j%3 != 0:
                c = elem_full.transformed(T)
                assembly.add_element(c)
            else:
                c = elem_ins.transformed(T)
                assembly.add_element(c)
# ---------- end assembly ----------

# ---- group: to JSON
export = PythonScript(DATA=py_2.DATA, assembly=assembly, export_to_json=Button())
# ---------- export: Python ----------
import os
#from compas.datastructures.mesh import mesh_quads_to_triangles
#from compas.datastructures.mesh import mesh_unify_cycles

if export_to_json:

    filename = "brickwall.json"
    PATH = os.path.join(DATA, filename)

    # the assembly has to be serialized such that it can be called from CPython
    assembly.to_json(PATH)

"""
if export_to_json_unity:
    
    for key, e in assembly.elements():
    
        #convert to trimesh
        mesh_quads_to_triangles(e._mesh, check_angles=False)
        #mesh_unify_cycles(e._mesh)
        #print e._mesh.faces
        #print e._mesh.face_vertices(list(e._mesh.faces())[0])

    filename = "brickwall_unity.json"
    PATH = os.path.join(DATA, filename)
    assembly.to_json(PATH)
"""
# ---------- end export ----------

# ----
show_6 = BooleanToggle(True)
network_viz = GhPythonScript(assembly=assembly, show_network=show_6, key=Slider(8, range=0..47))  # -> out, nodes, edges, current_node, current_node_neighbors; inputs key: Int32
# ---------- network_viz: Python ----------
import sys, os
import ghpythonlib.components as ghcomp
from compas.datastructures import Network
from compas_ghpython.artists import NetworkArtist
from compas_rhino.geometry import RhinoLine

import compas_ghpython
import Rhino.Geometry as rg


data = assembly.network.to_data()
network = Network.from_data(data)

print assembly.network.number_of_nodes()

def draw_network(network):
    """Draw a network in Grasshopper.
    """
    points = []
    for key, attr in network.nodes(True):
        points.append({
            'pos': network.node_coordinates(key),
        })

    lines = []
    for (u, v), attr in network.edges(True):
        lines.append({
            'start': network.node_coordinates(u),
            'end': network.node_coordinates(v),
        })

    points_rg = compas_ghpython.draw_points(points)
    lines_rg = compas_ghpython.draw_lines(lines)

    return points_rg, lines_rg

if show_network:
    nodes, edges = draw_network(network)
    
    current_node = {'pos': network.node_coordinates(key), 'radius': 0.03}
    current_node = compas_ghpython.draw_spheres([current_node])
    
    current_node_neighbors_keys = network.neighbors(key)
    current_node_neighbors = [{'pos': network.node_coordinates(key), 'radius': 0.02} for key in current_node_neighbors_keys]
    current_node_neighbors = compas_ghpython.draw_spheres(current_node_neighbors)
# ---------- end network_viz ----------
line = Line(network_viz.edges)
brep = Brep(network_viz.current_node)
brep_2 = Brep(network_viz.current_node_neighbors)
pt = Point(network_viz.nodes)
preview = CustomPreview(Geometry=brep_2, Material=ColourSwatch(SwatchColor=RGB(255, 207, 207)))
preview_2 = CustomPreview(Geometry=[brep, line], Material=ColourSwatch(SwatchColor=RGB(0, 0, 0)))

# ---- group: artist
key = Slider(388, range=0..388)
till_key = Button()
start = Button()
reset = Button()
stop = Button()
back = Button()
step = Button()
full = Button()
list = ValueList({"20", "50", "100", "500", "1000", "5000"}, selected="1000")

counter = CountThroughList(
    assembly=assembly,
    start=start,
    stop=stop,
    step=step,
    step_back=back,
    reset=reset,
    full=full,
    till_key=till_key,
    key=key,
    interval=list)  # -> item, counter; inputs start: Boolean, stop: Boolean, step_back: Boolean, key: Int32
# ---------- counter: Python ----------
from scriptcontext import sticky as st
from compas_ghpython import update_component


L = list(assembly.elements())
# store data in component
guid = str(ghenv.Component.InstanceGuid)
counter_key = "counter_" + guid
running_key = "running_" + guid

if counter_key not in st:
    st[counter_key] = 0

if running_key not in st:
    st[running_key] = False
    

if st[running_key]:
    if st[counter_key] < len(L) - 1:
        st[counter_key] += 1
        update_component(ghenv, interval)
    else:
        st[counter_key] = 0
        st[running_key] = False
    
    
if start:
    st[running_key] = True

if stop:
    st[running_key] = False

if step:
    if st[counter_key] < len(L) - 1:
        st[counter_key] += 1

if step_back:
    if  0 < st[counter_key] < len(L):
        st[counter_key] -= 1

if reset:
    st[counter_key] = 0

if till_key:
    st[counter_key] = key

if full:
    st[counter_key] = len(L)-1

if len(L):
    item = L[st[counter_key]]



#st["visualisation_counter"] = st[counter_key]
#st[counter_key]= 500
counter = st[counter_key]
# ---------- end counter ----------
idx = Panel(counter.counter)

# ---- group: artist / Assembly Artist
show_7 = BooleanToggle(True)
show_8 = BooleanToggle(False)
draw_3 = PythonScript(assembly=assembly, show_all=show_7, show_counter=show_8, counter=counter.counter)  # -> G, tool_planes_WCS, current_tool_plane; inputs counter: Int32
# ---------- draw_3: Python ----------
import os
import sys

import math

from compas.colors import Color
from compas.artists import Artist
from compas_ghpython.artists import NetworkArtist


G = []
color = Color.from_rgb255(220,165,165)

key_index = assembly.network.key_index()
keys = [key_index[key] for key in assembly.network.nodes()]
elements = [assembly.element(key) for key in keys]
#print elements
#print([(e.gripping_frame) for e in elements])

tool_planes_WCS = [Artist(e.tool_frame).draw() for e in elements]

current_tool_plane = tool_planes_WCS[counter]

if show_all and not show_counter:
    for element in elements:
        mesh = Artist(element.mesh).draw(color)
        G.append(mesh)

if show_counter:
    for element in elements[0:counter+1]:
        mesh = Artist(element.mesh).draw(color)
        G.append(mesh)
# ---------- end draw_3 ----------
pln = Plane(draw_3.tool_planes_WCS)
geo = Geometry(draw_3.G)
pln_2 = Plane(draw_3.current_tool_plane)

# ---- group: transformation values
number_slider = Slider(1, range=0.01..1)
context = Brep(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)
mesh_flip = MeshFlip(Mesh=mesh_2)
direct_sun_hours = DirectSunHours(geometry=mesh_flip, context=context, grid_size=number_slider, run=Toggle(True))  # -> points, results, mesh, sky_mtx
incidentradiation = LBIncidentRadiation(
    sky_mtx=direct_sun_hours.sky_mtx,
    geometry=flatten(geo),
    context=flatten(context),
    grid_size=number_slider,
    run=Toggle(False))  # -> out, points, results, total, mesh, legend, title, int_mtx; plug-in component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
mesh_3 = Mesh(direct_sun_hours.mesh)

# ----
mesh_4 = Mesh(incidentradiation.mesh)

# ==== cluster DirectSunHours
file_path = FilePath("C:\Users\Bootsy\Downloads\Braunschweig-hour.epw")
importepw = LBImportEPW(epw_file=file_path)  # -> location, dry_bulb_temperature, dew_point_temperature, relative_humidity, wind_speed, wind_direction, direct_normal_rad, diffuse_horizontal_rad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; plug-in component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
analysisperiod = LBAnalysisPeriod(
    start_month=Slider(3, range=0..10),
    start_day=Slider(1, range=0..10),
    start_hour=Slider(11, range=0..100),
    end_month=Slider(8, range=0..10),
    end_day=Slider(31, range=0..100),
    end_hour=Slider(16, range=0..100))  # -> period, hoys, dates; plug-in component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
sunpath = LBSunPath(north="0", location=importepw.location, hoys=analysisperiod.hoys, scale=0.05)  # -> out, vectors, altitudes, azimuths, hoys, sun_pts, analemma, daily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; plug-in component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
colrange = LBColorRange(index=22)  # -> colors; plug-in component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
legendpar = LBLegendParameters(colors=colrange)  # -> leg_par; plug-in component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
skymatrix = LBCumulativeSkyMatrix(
    north="0",
    location=importepw.location,
    direct_rad=importepw.direct_normal_rad,
    diffuse_rad=importepw.diffuse_horizontal_rad,
    hoys=analysisperiod.hoys)  # -> out, sky_mtx; plug-in component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
geometry = ClusterInput()
context = ClusterInput()
grid_size = ClusterInput()
run = ClusterInput()
sky_mtx = ClusterOutput(skymatrix.sky_mtx)
directsunhours = LBDirectSunHours(
    vectors=flatten(sunpath.vectors),
    geometry=flatten(geometry),
    context=flatten(context),
    grid_size=grid_size,
    offset_dist=0.01,
    legend_par=legendpar,
    run=run)  # -> out, points, results, mesh, legend, title, int_mtx; plug-in component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
points = ClusterOutput(directsunhours.points)
results = ClusterOutput(directsunhours.results)
mesh = ClusterOutput(directsunhours.mesh)
