# Grasshopper definition assembly_design_configurator.ghx (Grasshopper 1.0.8)
# plug-ins: RhinoCodePluginGH

compas = Python3Script()  # -> out
# ---------- compas: Python ----------
import compas
print(compas.__version__)
# ---------- end compas ----------

# ----
# Unload Python modules
button = Button()
unload = Python3Script(unload=button)  # -> out, a
# ---------- unload: Python ----------
from compas_ghpython import unload_modules

unload_modules('climate_active_envelopes')
unload_modules('assembly_information_model')
# ---------- end unload ----------

total_length = Panel(compas)

# ----
# Create empty assembly datastructure
# Recreate! >
button_2 = Button()
assembly = Python3Script(init=button_2)  # -> out, my_assembly
# ---------- assembly: Python ----------
from climate_active_envelopes.assembly import CAEAssembly as Assembly

#create empty assembly
my_assembly = Assembly()
# ---------- end assembly ----------

list = ValueList({"flemish_bond": 0}, selected="flemish_bond")
input_brep = Brep(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)
list_2 = ValueList({"rotate", "translate"}, selected="rotate")
transform = BooleanToggle(False)
list_3 = ValueList({"show brick wall": "show_brick_wall", "show color code": "show_color_code", "show nothing": "show_nothing"}, selected="show color code")

start_month = Slider(7, range=0..10)
start_day = Slider(1, range=0..10)
start_hour = Slider(11, range=0..100)
end_month = Slider(8, range=0..10)
end_hour = Slider(16, range=0..100)
end_day = Slider(31, range=0..100)

north_vector = Slider(120, range=0..360)
epw_file = FilePath("C:\Users\julia\Downloads\DEU_BY_Munich-Theresienwiese.108650_TMYx\DEU_BY_Munich-Theresienwiese.108650_TMYx.epw")
context = Brep([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])
run = BooleanToggle(True)
show_shading_map = BooleanToggle(False)
climate_simulation = ClimateSimulation(
    start_month=start_month,
    start_day=start_day,
    start_hour=start_hour,
    end_month=end_month,
    end_day=end_day,
    end_hour=end_hour,
    north=north_vector,
    geometry=input_brep,
    epw_file=epw_file,
    context=context,
    grid_size=Slider(0.08, range=0..0.1),
    run=run,
    show=show_shading_map)  # -> sun_pts, analemma, daily, compass, legend, title, color_values, M

# ----
# Generate brick assembly
# Choose your bond type here! >
# Set your unput geometry here >
# Choose the transformation type here! >
# Apply the transformation gradient
# based on the radiation profile here >
# Show the assembly or do not show >
brick_assembly = BrickAssembly(
    bond=list,
    brep=input_brep,
    my_assembly=assembly.my_assembly,
    values=climate_simulation.color_values,
    transform_type=list_2,
    transform_type_2=list_2,
    transform=transform,
    show=list_3)  # -> out, colored_parts_geometry, parts_geometry
geo = Geometry(brick_assembly.parts_geometry)
panel = Panel(brick_assembly.out)
preview = CustomPreview(Geometry=geo, Material=ColourSwatch(SwatchColor=RGB(196, 141, 141)))

run_2 = BooleanToggle(True)
sun_study = SunStudy(
    start_month=start_month,
    start_day=start_day,
    start_hour=start_hour,
    end_month=end_month,
    end_day=end_day,
    end_hour=end_hour,
    north=north_vector,
    geometry=brick_assembly.colored_parts_geometry,
    context=context,
    run=run_2)

# ----
# Climate Simulation
# Choose your
# analysis period here! >
# change the north direction here >
# If you want to change your epw. file, set it here! >
# Set your architectural context as brep here! >
# Change the resolution of the analysis here! >
# Run the simulation! >
# Vizualize the shading gradient of the input geometry! >
# Run the simulation! >
gradient_map_on_input_geometry = Mesh(climate_simulation.M)
crv = Curve([climate_simulation.analemma, climate_simulation.daily])
geo_2 = Geometry([climate_simulation.legend, climate_simulation.compass, climate_simulation.title, climate_simulation.sun_pts])
brick_wall = Mesh(sun_study)

# ==== cluster ClimateSimulation
epw_file = ClusterInput()
start_month = ClusterInput()
start_day = ClusterInput()
start_hour = ClusterInput()
end_month = ClusterInput()
end_day = ClusterInput()
end_hour = ClusterInput()
importepw = LBImportEPW(epw_file=epw_file)  # -> location, dry_bulb_temperature, dew_point_temperature, relative_humidity, wind_speed, wind_direction, direct_normal_rad, diffuse_horizontal_rad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; plug-in component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
analysisperiod = LBAnalysisPeriod(
    start_month=start_month,
    start_day=start_day,
    start_hour=start_hour,
    end_month=end_month,
    end_day=end_day,
    end_hour=end_hour)  # -> period, hoys, dates; plug-in component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
north = ClusterInput()
skymatrix = LBCumulativeSkyMatrix(
    north=north,
    location=importepw.location,
    direct_rad=importepw.direct_normal_rad,
    diffuse_rad=importepw.diffuse_horizontal_rad,
    hoys=analysisperiod.hoys)  # -> report, sky_mtx; plug-in component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
colrange = LBColorRange(index=Slider(5, range=0..100))  # -> colors; plug-in component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
geometry = ClusterInput()
context = ClusterInput()
grid_size = ClusterInput()
run = ClusterInput()
legendpar = LBLegendParameters(colors=colrange)  # -> leg_par; plug-in component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
incidentradiation = LBIncidentRadiation(
    sky_mtx=skymatrix.sky_mtx,
    geometry=flatten(geometry),
    context=flatten(context),
    grid_size=grid_size,
    offset_dist=Slider(0.2, range=0..1),
    legend_par=legendpar,
    run=run)  # -> report, points, results, total, mesh, legend, title, int_mtx; plug-in component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
vals = Python3Script(results=incidentradiation.results)  # -> out, color_values; inputs results: list
# ---------- vals: Python ----------
from compas.itertools import normalize_values

color_values = normalize_values(results, 0.0, 0.7)
print(color_values)




"""
color_points = []

for i, point in enumerate(points):
    frame = Frame([color_values[i], point[1] , point[2]], [1,0,0], [0,1,0])
    
    color_points.append(frame.point)
"""
# ---------- end vals ----------
show = ClusterInput()
color_values = ClusterOutput(vals.color_values)
visualize = Python3Script(show=show, mesh=incidentradiation.mesh)  # -> out, M
# ---------- visualize: Python ----------
if show == True:
    M = mesh
# ---------- end visualize ----------
pt = Point(Point(6.146412243, 26.72663197, 0))
sunpath = LBSunPath(north=north, location=importepw.location, hoys=analysisperiod.hoys, center_pt=pt, scale=Slider(0.6, range=0..10))  # -> report, vectors, altitudes, azimuths, hoys, sun_pts, analemma, daily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; plug-in component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
M = ClusterOutput(visualize.M)
compass = ClusterOutput(sunpath.compass)
analemma = ClusterOutput(sunpath.analemma)
sun_pts = ClusterOutput(sunpath.sun_pts)
legend = ClusterOutput(sunpath.legend)
daily = ClusterOutput(sunpath.daily)
title = ClusterOutput(sunpath.title)

# ==== cluster SunStudy
path = FilePath("C:\Users\julia\Downloads\DEU_BY_Munich-Theresienwiese.108650_TMYx\DEU_BY_Munich-Theresienwiese.108650_TMYx.epw")
start_month = ClusterInput()
start_day = ClusterInput()
start_hour = ClusterInput()
end_month = ClusterInput()
end_day = ClusterInput()
end_hour = ClusterInput()
importepw = LBImportEPW(epw_file=path)  # -> location, dry_bulb_temperature, dew_point_temperature, relative_humidity, wind_speed, wind_direction, direct_normal_rad, diffuse_horizontal_rad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; plug-in component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
analysisperiod = LBAnalysisPeriod(
    start_month=start_month,
    start_day=start_day,
    start_hour=start_hour,
    end_month=end_month,
    end_day=end_day,
    end_hour=end_hour)  # -> period, hoys, dates; plug-in component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
north = ClusterInput()
skymatrix = LBCumulativeSkyMatrix(
    north=north,
    location=importepw.location,
    direct_rad=importepw.direct_normal_rad,
    diffuse_rad=importepw.diffuse_horizontal_rad,
    hoys=analysisperiod.hoys)  # -> report, sky_mtx; plug-in component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
colrange = LBColorRange(index="0")  # -> colors; plug-in component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
geometry = ClusterInput()
context = ClusterInput()
run = ClusterInput()
legendpar = LBLegendParameters()  # -> leg_par; plug-in component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
incidentradiation = LBIncidentRadiation(
    sky_mtx=skymatrix.sky_mtx,
    geometry=flatten(geometry),
    context=flatten(context),
    grid_size=Slider(1, range=0..1),
    offset_dist=Slider(0.2, range=0..1),
    legend_par=legendpar,
    run=run)  # -> report, points, results, total, mesh, legend, title, int_mtx; plug-in component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
mesh = ClusterOutput(incidentradiation.mesh)

# ==== cluster BrickAssembly
transform_type = ClusterInput()
list = ValueList({"none", "full", "insulated"}, selected="full")
layer_height = Slider(0.1, range=0..1)
part = Python3Script()  # -> out, full_brick, insulated_brick
# ---------- part: Python ----------
import os
from compas.geometry import Frame, Box
from compas.datastructures import Mesh
from climate_active_envelopes.assembly import CAEPart as Part



#full_brick
length, width, height = 0.24, 0.115, 0.075
full_brick = Part.from_dimensions(length=length, width=width, height=height)
full_brick.attributes['name'] = "full_brick"
#print(full_brick.attributes)
print(full_brick.__data__)

#insulated_brick_placeholder
# length, width, height = 0.245, 0.12, 0.075
# insulated_brick = Part.from_dimensions(length=length, width=width, height=height)
# insulated_brick.attributes['name'] = "insulated_brick"
# print(insulated_brick.__data__)



#insulated_brick
package_path = ghdoc.Path
data_path = os.path.abspath(os.path.join(package_path,"../../../climate_active_envelopes/data/brick_types"))
filename = 'insulated_brick_reduced.stl'
insulated_brick_mesh = Mesh.from_stl(os.path.join(data_path, filename))
insulated_brick = Part.from_mesh_and_frame(insulated_brick_mesh)
insulated_brick.attributes['name'] = "insulated_brick"
#print(insulated_brick.__data__)
# ---------- end part ----------
brep = ClusterInput()
values = ClusterInput()
transform_type_2 = ClusterInput()
transform = ClusterInput()
contour = Python3Script(brep=brep, layer_height=layer_height)  # -> out, curves; inputs brep: Mesh, layer_height: Double
# ---------- contour: Python ----------
import Rhino.Geometry as rg

mesh = brep

vertices = mesh.Vertices
pt_base = vertices[0]
pt_end = vertices[2]
print(pt_end)

pt_base = vertices[0]
pt_end = vertices[1]


start_plane = rg.Plane(pt_base, rg.Vector3d(0, 0, 1))
end_plane = rg.Plane(pt_end, rg.Vector3d(0, 0, 1))

curves =rg.Mesh.CreateContourCurves(mesh, pt_base,  pt_end, layer_height)
# ---------- end contour ----------
draw = Python3Script(full_brick=part.full_brick, insulated_brick=part.insulated_brick, show=list)  # -> M, P
# ---------- draw: Python ----------
from compas_rhino.conversions import mesh_to_rhino, box_to_rhino, frame_to_rhino
from climate_active_envelopes.assembly import CAEPart as Part
from compas.geometry import Frame
from compas.geometry import Vector
from compas.geometry import Box


if show=="full":

    #extract the mesh of the part for visulization
    compas_mesh_full = full_brick.mesh

    #convert to rhino mesh
    M = mesh_to_rhino(compas_mesh_full)

    #extract and convert to rhino plane
    P = frame_to_rhino(full_brick.frame)
    #brick_full.gripping_frame = full_brick.frame
    #print(full_brick.__data__)
    print(type(full_brick))

    
elif show == "insulated":
    
    #extract the mesh of the part for visulization
    compas_mesh_insulated = insulated_brick.mesh

    #convert to rhino mesh
    M = mesh_to_rhino(compas_mesh_insulated)
    
    #extract and convert to rhino plane
    P = frame_to_rhino(insulated_brick.frame)

else:
    pass
# ---------- end draw ----------
mesh = Mesh(draw.M)
pln = Plane(draw.P)
crv = Curve(contour.curves)
show = ClusterInput()
bond = ClusterInput()
my_assembly = ClusterInput()
create_assembly = Python3Script(
    bond=bond,
    my_assembly=my_assembly,
    brick_full=part.full_brick,
    brick_insulated=part.insulated_brick,
    plane=pln,
    lines=contour.curves)  # -> out, my_assembly, total_length; inputs plane: Plane, lines: list of Line
# ---------- create_assembly: Python ----------
total_length = my_assembly.generate_wall(bond,
                        brick_full, 
                        brick_insulated,
                        plane,
                        lines
                        )
# ---------- end create_assembly ----------
get_centroids = Python3Script(my_assembly=create_assembly.my_assembly, transform_type=transform_type)  # -> out, my_assembly, keys; inputs transform_type: String
# ---------- get_centroids: Python ----------
from compas.geometry import Frame, Translation, Rotation, Transformation, Point
from compas_rhino.conversions import plane_to_compas_frame, point_to_compas

import math
import Rhino.Geometry as rg

values = []
keys = []


for key in my_assembly.graph.nodes_where({"transform_type": transform_type}):
    part = my_assembly.part(key)
    keys.append(key)

my_assembly = my_assembly
# ---------- end get_centroids ----------
apply_gradient = Python3Script(
    my_assembly=create_assembly.my_assembly,
    values=values,
    keys=get_centroids.keys,
    transform_type=transform_type_2,
    transform=transform)  # -> out, my_assembly; inputs values: list, keys: list
# ---------- apply_gradient: Python ----------
import math
import Rhino.Geometry as rg
from compas.geometry import Frame, Point
from compas.geometry import Transformation, Rotation, Translation


#print(my_assembly.apply_gradient(values, keys, transform_type_))


#print(my_assembly.__data__)

#transform_types = {node_id: my_assembly.graph.node_attribute(node_id, 'transform_type') for node_id in my_assembly.graph.nodes()}




if transform:
    assembly = my_assembly
    my_assembly.apply_gradient(values, keys, transform_type)

    #print(test)
# ---------- end apply_gradient ----------
visualize = Python3Script(my_assembly=apply_gradient.my_assembly, show=show)  # -> out, colored_parts_geometry, parts_geometry
# ---------- visualize: Python ----------
from compas_rhino.conversions import mesh_to_rhino, box_to_rhino, frame_to_rhino

#print assembly
print(my_assembly)
#counter = int(counter)

#get parts datastructure
parts = [p for p in my_assembly.parts()]

#get current part

#if show_wall == True:

if show == "show_brick_wall":
    
#get parts datastructure
    parts = [p for p in my_assembly.parts()]
    parts_geometry = []
    parts_frame = []

    #part = parts[0]
    #print(part.gripping_frame)

    #extract the mesh of the parts for visulization (+ converted to rhino mesh)
    parts_geometry = [mesh_to_rhino(p.mesh) for p in parts]
    
    #extract the frame of the parts for visulization (+ converted to rhino plane)
    parts_frame = [frame_to_rhino(p.frame) for p in parts]
    #print(parts_geometry)

    key = my_assembly.graph.number_of_nodes()-1


elif show == "show_color_code":
    #get parts datastructure
    parts = [p for p in my_assembly.parts()]
    colored_parts_geometry = []
    parts_frame = []

    #part = parts[0]
    #print(part.gripping_frame)

    #extract the mesh of the parts for visulization (+ converted to rhino mesh)
    colored_parts_geometry = [mesh_to_rhino(p.mesh) for p in parts]
    
    #extract the frame of the parts for visulization (+ converted to rhino plane)
    parts_frame = [frame_to_rhino(p.frame) for p in parts]
    #print(parts_geometry)

    key = my_assembly.graph.number_of_nodes()-1

else:
    print("Nothing to see")
    pass
# ---------- end visualize ----------
out = ClusterOutput(visualize.out)
colored_parts_geometry = ClusterOutput(visualize.colored_parts_geometry)
parts_geometry = ClusterOutput(visualize.parts_geometry)
