# Grasshopper definition reading_3D_model.ghx (Grasshopper 1.0.8)

assembly = Python3Script(init=Button())  # -> out, my_assembly
# ---------- assembly: Python ----------
from climate_active_envelopes.assembly import CAEAssembly as Assembly

#create empty assembly
my_assembly = Assembly()
# ---------- end assembly ----------

# ----
# Generate brick parts
list = ValueList({"none", "full", "insulated", "half"}, selected="half")
part = Python3Script()  # -> out, brick_full, brick_insulated, brick_half
# ---------- part: Python ----------
import os
from compas.geometry import Frame, Box
from compas.datastructures import Mesh
from climate_active_envelopes.assembly import CAEPart as Part



#brick_full
length, width, height = 0.24, 0.115, 0.075
brick_full = Part.from_dimensions(length=length, width=width, height=height)
brick_full.attributes['name'] = "brick_full"
print(brick_full.frame)
#print(brick_full.attributes)
print(brick_full.__data__)


#brick_insulated_placeholder_new
length, width, height = 0.24, 0.115, 0.075
brick_insulated = Part.from_dimensions(length=length, width=width, height=height)
brick_insulated.attributes['name'] = "brick_insulated"
print(brick_insulated.__data__)


# #brick_insulated_placeholder
# length, width, height = 0.245, 0.12, 0.075
# brick_insulated = Part.from_dimensions(length=length, width=width, height=height)
# brick_insulated.attributes['name'] = "brick_insulated"
# print(brick_insulated.__data__)

#corner brick
length, width, height = 0.245, 0.06, 0.075
brick_half = Part.from_dimensions(length=length, width=width, height=height)
brick_half.attributes['name'] = "brick_half"
print(brick_half.__data__)

#brick_insulated
# package_path = ghdoc.Path
# data_path = os.path.abspath(os.path.join(package_path,"../../../climate_active_envelopes/data/brick_types"))
# filename = 'brick_insulated_reduced.stl'
# brick_insulated_mesh = Mesh.from_stl(os.path.join(data_path, filename))
# brick_insulated = Part.from_mesh_and_frame(brick_insulated_mesh)
# brick_insulated.attributes['name'] = "brick_insulated"
# #print(brick_insulated.__data__)
# ---------- end part ----------
draw = Python3Script(brick_full=part.brick_full, brick_insulated=part.brick_insulated, brick_half=part.brick_half, show=list)  # -> M, P
# ---------- draw: Python ----------
from compas_rhino.conversions import mesh_to_rhino, box_to_rhino, frame_to_rhino
from climate_active_envelopes.assembly import CAEPart as Part
from compas.geometry import Frame
from compas.geometry import Vector
from compas.geometry import Box


if show=="full":

    #extract the mesh of the part for visulization
    compas_mesh_full = brick_full.mesh

    #convert to rhino mesh
    M = mesh_to_rhino(compas_mesh_full)

    #extract and convert to rhino plane
    P = frame_to_rhino(brick_full.frame)
    #brick_full.gripping_frame = full_brick.frame
    #print(full_brick.__data__)
    print(type(brick_full))

    
elif show == "insulated":
    
    #extract the mesh of the part for visulization
    compas_mesh_insulated = brick_insulated.mesh

    #convert to rhino mesh
    M = mesh_to_rhino(compas_mesh_insulated)
    
    #extract and convert to rhino plane
    P = frame_to_rhino(brick_insulated.frame)

elif show == "half":

    #extract the mesh of the part for visulization
    compas_mesh_half = brick_half.mesh

    #convert to rhino mesh
    M = mesh_to_rhino(compas_mesh_half)
    
    #extract and convert to rhino plane
    P = frame_to_rhino(brick_half.frame)

else:
    pass
# ---------- end draw ----------
mesh = Mesh(draw.M)
pln = Plane(draw.P)

curve = Curve(<curve referenced from the Rhino model>)
divide = DivideCurve(Curve=curve, Count=20, Kinks=False)  # -> Points, Tangents, Parameters
pt = Point(divide.Points)

x_axis = Curve(<curve referenced from the Rhino model>)
y_axis = Curve(<curve referenced from the Rhino model>)
plane = Python3Script(plane_axes=[x_axis, y_axis])  # -> out, plane; inputs plane_axes: list of Curve
# ---------- plane: Python ----------
import Rhino.Geometry as rg

x_axis, y_axis = plane_axes

x_axis = rg.Line(x_axis.PointAtStart, x_axis.PointAtEnd)
y_axis = rg.Line(y_axis.PointAtStart, y_axis.PointAtEnd)

if x_axis.From.DistanceTo(y_axis.From) < 0.01:
    origin = x_axis.From
    xvec = x_axis.Direction
    yvec = y_axis.Direction
elif x_axis.To.DistanceTo(y_axis.To) < 0.01:
    origin = x_axis.To
    xvec = -x_axis.Direction
    yvec = -y_axis.Direction
elif x_axis.From.DistanceTo(y_axis.To) < 0.01:
    origin = x_axis.From
    xvec = x_axis.Direction
    yvec = -y_axis.Direction
elif x_axis.To.DistanceTo(y_axis.From) < 0.01:
    origin = x_axis.To
    xvec = -x_axis.Direction
    yvec = y_axis.Direction

plane = rg.Plane(origin, xvec, yvec)
# ---------- end plane ----------

compas = Python3Script()  # -> out; disabled
# ---------- compas: Python ----------
import compas
print(compas.__version__)
# ---------- end compas ----------

# ----
# Sequencing
panel = Panel("sequence:")

# ----
# Unload Python modules
button = Button()
unload = Python3Script(unload=button)  # -> out, a
# ---------- unload: Python ----------
from compas_ghpython import unload_modules

unload_modules('climate_active_envelopes')
unload_modules('assembly_information_model')
# ---------- end unload ----------

compas___version = Panel(compas)  # disabled

list_2 = ValueList({"1": 0, "2": 20, "3": 10, "4": 2, "5": 18, "6": 0, "7": 20, "8": 10, "9": 3, "10": 16}, selected="1")
py3 = Python3Script(start_plane=plane.plane, pts=divide.Points, idx=list_2)  # -> out, robot_origin_frame; inputs pts: list of Point3d, idx: Int32
# ---------- py3: Python ----------
import math

import Rhino.Geometry as rg
import ghpythonlib.components as ghcomp

#from compas_ghpython import draw_frame
from compas.geometry import Frame

sp = start_plane



planes = [rg.Plane(pt, sp.XAxis, sp.YAxis) for pt in pts]
frames = [Frame(p.Origin, p.XAxis, p.YAxis) for p in planes]

robot_origin_plane = planes[idx]
robot_origin_frame = frames[idx]
# ---------- end py3 ----------

bricks_half = Brep([<brep referenced from the Rhino model> x78])

# ----
# Generate brick assembly
bricks_insulated = Brep([<brep referenced from the Rhino model> x881])
bricks_full = Brep([<brep referenced from the Rhino model> x737])
add_bricks = Python3Script(
    my_assembly=assembly.my_assembly,
    bricks_full=bricks_full,
    bricks_insulated=bricks_insulated,
    bricks_half=bricks_half,
    brick_full=part.brick_full,
    brick_insulated=part.brick_insulated,
    brick_half=part.brick_half)  # -> out, planes, my_assembly; inputs bricks_full: list of Brep, bricks_insulated: list of Brep, bricks_half: list of Brep
# ---------- add_bricks: Python ----------
from compas.geometry import Frame, Box, Transformation, Vector, Brep, cross_vectors
from compas_rhino.geometry import RhinoBrep
from compas_rhino.conversions import box_to_compas, frame_to_rhino_plane, plane_to_compas_frame, mesh_to_compas
import Rhino.Geometry as rg

my_assembly.set_brick_params(brick_full, brick_insulated, brick_half)



# for brick in bricks_full:
#     bbox = brick.GetBoundingBox(True)

#     if brick.Faces.Count > 0:
#         face = brick.Faces[5]
        
#         # Get the underlying surface of the face
#         #surface = face.UnderlyingSurface()
#         # Evaluate the surface at its center to get a frame
#         u, v = face.Domain(0).Mid, face.Domain(1).Mid #edge_length
        
#         plane = face.FrameAt(u, v)
#         frame = plane_to_compas_frame(plane[1])

#         T = Transformation.from_frame_to_frame(brick_full.frame, frame)
#         brick_full = brick_full.transformed(T)
#         brick_insulated = brick_insulated.transformed(T)
#         brick_half = brick_half.transformed(T)
#         #new_brick = brick_full.transformed(Transformation.from_frame(frame))
#         brick_full.frame = frame
#         brick_insulated.frame = frame
#         brick_half.frame = frame

#     part_key = my_assembly.add_part(brick_full, attr_dict={"brick_type": "full_brick"})
#     z_value = frame.point.z
#     my_assembly.graph.node_attribute(part_key, 'z', z_value)



    #box = brep_to_compas_box(brick)

    #compas_mesh = mesh_to_compas(mesh)

    # rhino_mesh = rg.Mesh.CreateFromBrep(brick, rg.MeshingParameters.Default)[0]

    # mesh = mesh_to_compas(rhino_mesh)
    #mesh.frame = frame
        
    #part_key = my_assembly.add_part(mesh, attr_dict={"brick_type": "full_brick"})



    # # Add the new brick to the assembly
    # part_key = my_assembly.add_part(new_brick, attr_dict={"brick_type": "full_brick"})
    # z_value = frame.point.z
    # my_assembly.graph.node_attribute(part_key, 'z', z_value)





## working definition
# def add_bricks_to_assembly(brick_list, brick_type):
#     for brep in brick_list:
#         box = box_to_compas(brep)
#         mesh = Box.to_mesh(box)
#         frame = Frame(mesh.centroid(), [1, 0, 0], [0, 1, 0])
#         mesh.frame = frame

#         part_key = my_assembly.add_part(mesh, attr_dict={"brick_type": brick_type})
#         z_value = frame.point.z
#         my_assembly.graph.node_attribute(part_key, 'z', z_value)

# # Add full bricks to the assembly
# add_bricks_to_assembly(bricks_full, "full_brick")

# # Add insulated bricks to the assembly
# add_bricks_to_assembly(bricks_insulated, "insulated_brick")

def add_bricks_to_assembly(brick_list, brick_type):
    for brick in brick_list:
        bbox = brick.GetBoundingBox(True)

        if brick.Faces.Count > 0:
            face = brick.Faces[5]
            
            # Get the underlying surface of the face
            #surface = face.UnderlyingSurface()
            # Evaluate the surface at its center to get a frame
            u, v = face.Domain(0).Mid, face.Domain(1).Mid #edge_length
            plane = face.FrameAt(u, v)
            frame = plane_to_compas_frame(plane[1])

            brick_part = my_assembly.brick_params[brick_type]
            T = Transformation.from_frame_to_frame(brick_part.frame, frame)

            part = brick_part.transformed(T)
            part.frame = frame


        part_key = my_assembly.add_part(part, attr_dict={"brick_type": brick_type})
        z_value = frame.point.z
        my_assembly.graph.node_attribute(part_key, 'z', z_value)

add_bricks_to_assembly(bricks_full, "brick_full")
add_bricks_to_assembly(bricks_insulated, "brick_insulated")
add_bricks_to_assembly(bricks_half, "brick_half")
# ---------- end add_bricks ----------
add_connections = Python3Script(my_assembly=add_bricks.my_assembly)  # -> out, my_assembly
# ---------- add_connections: Python ----------
# # Get the sorted courses
courses = my_assembly.assembly_courses(tol=0.01)

# Add connections between adjacent bricks in each course
for course in courses:
    for i in range(len(course) - 1):
        a_key = course[i]
        b_key = course[i + 1]
        my_assembly.add_connection(a_key, b_key)

print(my_assembly)
# ---------- end add_connections ----------
pln_2 = Plane(add_bricks.planes)

py3_2 = Python3Script(
    assembly=add_connections.my_assembly,
    robot_origin_frame=py3.robot_origin_frame,
    compute_sequ_in_reach=Button(),
    clear_sequ=Button())  # -> out, assembly
# ---------- py3_2: Python ----------
#from assembly_information_model.assembly.sequencing import assembly_building_sequence
from random import choice
from collections import deque
from compas.geometry import Point
from scriptcontext import sticky as st

# store data in component
guid = str(ghenv.Component.InstanceGuid)
patch_num = "patch_num_" + guid

if patch_num not in st:
    st[patch_num] = 1


def get_nbrs_under(key):
    """ return the neighbors under the chosen brick
    """
    nbrs = assembly.network.neighbors(key)
    nbrs_under = [n for n in nbrs if assembly.network.node_attribute(n, "course")<assembly.network.node_attribute(key, "course")]

    return nbrs_under

def is_node_satisfied(key):

    nbrs_under = get_nbrs_under(key)
    
    #print key
    #print len(nbrs_under)

    if len(nbrs_under):
        for n in nbrs_under:
            if assembly.network.node_attribute(n, "used") == False:
                return False
    return True

def dist_to_frame(key, robot_origin):
    
    element_origin = assembly.element(key).frame
    
    # ro = robot_origin.point
    # ro_mirror = Point(ro.x, -(ro.y)-0.2, ro.z-0.35)
    # print ro_mirror
    
    # dist = ro_mirror.distance_to_point(element_origin.point)
    
    return dist

if clear_sequ:
    assembly.graph.nodes_attribute(name='used', value=0)
    assembly.graph.nodes_attribute(name='patch', value=0)
    st[patch_num] = 1
    
if compute_sequ_in_reach:
    
    assembly.graph.nodes_attribute(name='used', value=0)
    assembly.graph.nodes_attribute(name='patch', value=0)
    
    keys = list(assembly.graph.nodes_where({"used": False}))
    
    keys_in_patch = []
    for key in keys:
        #print key
        dist = dist_to_frame(key, robot.base_frame)
        #dist = dist_to_frame(key, robot.base_frame)
        if dist < 1.05:
            if is_node_satisfied(key):
                keys_in_patch.append(key)
                assembly.network.node_attribute(key, 'used', True)
    print(keys_in_patch)
    assembly.network.nodes_attribute(name='patch', value=st[patch_num], keys=keys_in_patch)
    st[patch_num]+=1
# ---------- end py3_2 ----------

# ----
# Export to JSON
export = Button()
path = Python3Script()  # -> HERE, DATA, ASSEMBLY
# ---------- path: Python ----------
import os

HERE = os.path.dirname(ghdoc.Path)
DATA = os.path.abspath(os.path.join(HERE, "..", "data"))
ASSEMBLY = os.path.abspath(os.path.join(DATA, "assembly"))

print(HERE)
print(DATA)
print(ASSEMBLY)
# ---------- end path ----------
export_2 = Python3Script(ASSEMBLY=path.ASSEMBLY, my_assembly=py3_2.assembly, export=export)  # -> out; inputs ASSEMBLY: String
# ---------- export_2: Python ----------
import os


    

#print(my_assembly.__data__)
if export:
    #print(DATA)
    filename = "250211_brickwall_2.json"
    PATH = os.path.join(ASSEMBLY, filename)

    # the assembly has to be serialized such that it can be called from CPython
    my_assembly.to_json(PATH, pretty=True)
    print(my_assembly)
# ---------- end export_2 ----------

full = Button()
start = Button()
stop = Button()
step = Button()
back = Button()
reset = Button()
list_3 = ValueList({"20", "50", "100", "500", "1000", "5000"}, selected="5000")

list_4 = ValueList({"show all": "show_all", "show until key": "show_until_key", "show nothing": "show_nothing"}, selected="show until key")

button_2 = Button()  # disabled
assembly_2 = Python3Script(init=button_2)  # -> out, my_assembly; disabled; same code as assembly
brep = Brep([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])  # disabled
add_brick_model = Python3Script(my_assembly=assembly_2.my_assembly, brick_model=brep)  # -> out, my_assembly; inputs brick_model: list of Box; disabled
# ---------- add_brick_model: Python ----------
from compas.geometry import Frame, Box, Transformation
from compas_rhino.conversions import box_to_compas

my_assembly.set_brick_params(brick_full, brick_insulated, brick_half)



for brep in brick_model:
    box = box_to_compas(brep)
    mesh = Box.to_mesh(box)
    frame = Frame(mesh.centroid(), [1, 0, 0], [0, 1, 0])
    mesh.frame = frame
    part_key = my_assembly.add_part(mesh, attr_dict={"brick_type": "full_brick"})
    z_value = frame.point.z
    my_assembly.graph.node_attribute(part_key, 'z', z_value)


current_part = my_assembly.part(part_key)
print(current_part.attributes)
# ---------- end add_brick_model ----------
add_connections_2 = Python3Script(my_assembly=add_brick_model.my_assembly)  # -> out, my_assembly; disabled; same code as add_connections

# ----
# Visualisation Dashboard
counter = Python3Script(
    my_assembly=add_connections.my_assembly,
    start=start,
    stop=stop,
    step=step,
    step_back=back,
    reset=reset,
    full=full,
    interval=list_3)  # -> out, current_key, counter
# ---------- counter: Python ----------
from scriptcontext import sticky as st
import Grasshopper

def update_component(ghenv, delay):
    """Schedule an update of the Grasshopper component.

    After the specified delay, the GH component will be automatically updated.

    Parameters
    ----------
    ghenv : :class:`GhPython.Component.PythonEnvironment`
        The current GHPython environment.
    delay : :obj:`int`
        Time in milliseconds until the update is performed.

    Raises
    ------
    ValueError
        If the delay is less than zero.

    """
    if delay <= 0:
        raise ValueError("Delay must be greater than zero")

    ghcomp = ghenv.Component
    ghdoc = ghcomp.OnPingDocument()

    def callback(ghdoc):
        if ghdoc.SolutionState != Grasshopper.Kernel.GH_ProcessStep.Process:
            ghcomp.ExpireSolution(False)

    ghdoc.ScheduleSolution(delay, Grasshopper.Kernel.GH_Document.GH_ScheduleDelegate(callback))


courses = my_assembly.assembly_courses(tol=0.01)
#print(courses)


L = [node for course in courses for node in course]


guid = str(ghenv.Component.InstanceGuid)
counter_key = "counter_" + guid
running_key = "running_" + guid

if counter_key not in st:
    st[counter_key] = 0

if running_key not in st:
    st[running_key] = False

if st[running_key]:
    if st[counter_key] < len(L) - 1:
        st[counter_key] += 1
        update_component(ghenv, interval)
    else:
        st[counter_key] = 0
        st[running_key] = False

if start:
    st[running_key] = True

if stop:
    st[running_key] = False

if step:
    if st[counter_key] < len(L) - 1:
        st[counter_key] += 1

if step_back:
    if st[counter_key] < len(L) - 1:
        st[counter_key] -= 1

if reset:
    st[counter_key] = 0
    st[running_key] = False

if full:
    st[counter_key] = len(L) - 1

if len(L):
    item = L[st[counter_key]]
    print(f"Current node item: {item}")

#st["visualisation_counter"] = st[counter_key]
counter = st[counter_key] + 1

current_key = item
# ---------- end counter ----------
panel_2 = Panel(counter.counter)

visualize = Python3Script(
    my_assembly=add_connections.my_assembly,
    show=list_4,
    highlight_current_part=Toggle(True),
    current_key=counter.current_key)  # -> out, parts_geometry, parts_frame, current_part_geometry, current_part_frame, current_part_gripping_frame
# ---------- visualize: Python ----------
from compas_rhino.conversions import mesh_to_rhino, box_to_rhino, frame_to_rhino

courses = my_assembly.assembly_courses(tol=0.01)
L = [node for course in courses for node in course]


#get parts datastructure
parts = [p for p in my_assembly.parts()]


if show == "show_all":
    
#get parts datastructure
    parts = [p for p in my_assembly.parts()]
    parts_geometry = []
    parts_frame = []

    #part = parts[0]
    #print(part.gripping_frame)

    #extract the mesh of the parts for visulization (+ converted to rhino mesh)
    for p in parts:
        print(p)
        parts_geometry.append(mesh_to_rhino(p))
    
    #extract the frame of the parts for visulization (+ converted to rhino plane)
    parts_frame = [frame_to_rhino(p.frame) for p in parts]
    key = my_assembly.graph.number_of_nodes()-1

if show == "show_until_key":

    current_index = L.index(current_key)
    keys_to_visualize = L[:current_index + 1]

    parts_geometry = [mesh_to_rhino(parts[key].mesh) for key in keys_to_visualize]
    parts_frame = [frame_to_rhino(parts[key].frame) for key in keys_to_visualize]

    key = current_key


if show == "show_nothing":
    print("Nothing to see")
    pass

if highlight_current_part:
    current_part = my_assembly.part(key)
    current_part_geometry = mesh_to_rhino(current_part.mesh)
    current_part_frame = frame_to_rhino(current_part.frame)
    #current_part_gripping_frame = frame_to_rhino(current_part.gripping_frame)
    
    print(current_part.__data__)
# ---------- end visualize ----------
panel_3 = Panel(counter.current_key)

geo = Geometry(visualize.parts_geometry)
geo_2 = Geometry(visualize.parts_frame)
geo_3 = Geometry(visualize.current_part_geometry)
geo_4 = Geometry(visualize.current_part_gripping_frame)
preview = CustomPreview(Geometry=geo, Material=ColourSwatch(SwatchColor=RGB(196, 141, 141)))
preview_2 = CustomPreview(Geometry=geo_2, Material=ColourSwatch(SwatchColor=RGB(255, 125, 157)))
preview_3 = CustomPreview(Geometry=geo_3, Material=ColourSwatch(SwatchColor=RGB(255, 125, 157)))
preview_4 = CustomPreview(Geometry=geo_4, Material=ColourSwatch(SwatchColor=RGB(255, 125, 157)))

panel_4 = Panel(visualize.out)
draw_2 = Python3Script(planes=geo_4, scale=Slider(0.2, range=0..1))  # -> out, P, V, C, W; inputs planes: list of Plane
# ---------- draw_2: Python ----------
from System.Drawing import Color

red = Color.FromArgb(255, 0, 0)
green = Color.FromArgb(0, 255, 0)
blue = Color.FromArgb(0, 0, 255)

P = []
V = []
C = []

scale = float(scale)

for plane in planes:
    if not plane:
        continue
    P += [plane.Origin] * 3
    V.append(plane.XAxis * scale)
    V.append(plane.YAxis * scale)
    V.append(plane.ZAxis * scale)
    C += [red, green, blue]

W = 3
# ---------- end draw_2 ----------
vdisex = VectorDisplayEx(Point=draw_2.P, Vector=draw_2.V, Colour=draw_2.C, Width=draw_2.W)
