# Grasshopper definition test_shape_diver.ghx (Grasshopper 1.0.8)
# plug-ins: RhinoCodePluginGH

# ---- group: ignore
list = ValueList({"none", "full", "insulated"}, selected="full")

layer_height = Slider(0.1, range=0..1)

# ----
compas = Python3Script()  # -> out
# ---------- compas: Python ----------
import compas
print(compas.__version__)
# ---------- end compas ----------

# ---- group: ignore
button = Button()

# ----
total_length = Panel(compas)

# ----
# Generate brick parts
part = Python3Script()  # -> out, full_brick, insulated_brick
# ---------- part: Python ----------
import os
from compas.geometry import Frame, Box
from compas.datastructures import Mesh
from climate_active_envelopes.assembly import CAEPart as Part



#full_brick
length, width, height = 0.24, 0.115, 0.075
full_brick = Part.from_dimensions(length=length, width=width, height=height)
full_brick.attributes['name'] = "full_brick"
#print(full_brick.attributes)
print(full_brick.__data__)

#insulated_brick_placeholder
# length, width, height = 0.245, 0.12, 0.075
# insulated_brick = Part.from_dimensions(length=length, width=width, height=height)
# insulated_brick.attributes['name'] = "insulated_brick"
# print(insulated_brick.__data__)



#insulated_brick
package_path = ghdoc.Path
data_path = os.path.abspath(os.path.join(package_path,"../../../climate_active_envelopes/data/brick_types"))
filename = 'insulated_brick_reduced.stl'
insulated_brick_mesh = Mesh.from_stl(os.path.join(data_path, filename))
insulated_brick = Part.from_mesh_and_frame(insulated_brick_mesh)
insulated_brick.attributes['name'] = "insulated_brick"
#print(insulated_brick.__data__)
# ---------- end part ----------
draw = Python3Script(full_brick=part.full_brick, insulated_brick=part.insulated_brick, show=list)  # -> M, P
# ---------- draw: Python ----------
from compas_rhino.conversions import mesh_to_rhino, box_to_rhino, frame_to_rhino
from climate_active_envelopes.assembly import CAEPart as Part
from compas.geometry import Frame
from compas.geometry import Vector
from compas.geometry import Box


if show=="full":

    #extract the mesh of the part for visulization
    compas_mesh_full = full_brick.mesh

    #convert to rhino mesh
    M = mesh_to_rhino(compas_mesh_full)

    #extract and convert to rhino plane
    P = frame_to_rhino(full_brick.frame)
    #brick_full.gripping_frame = full_brick.frame
    #print(full_brick.__data__)
    print(type(full_brick))

    
elif show == "insulated":
    
    #extract the mesh of the part for visulization
    compas_mesh_insulated = insulated_brick.mesh

    #convert to rhino mesh
    M = mesh_to_rhino(compas_mesh_insulated)
    
    #extract and convert to rhino plane
    P = frame_to_rhino(insulated_brick.frame)

else:
    pass
# ---------- end draw ----------
mesh = Mesh(draw.M)
pln = Plane(draw.P)

sd_input_geometry = Brep(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)

# ----
# Create empty assembly datastructure
refresh = Button()
assembly = Python3Script(init=refresh)  # -> out, my_assembly
# ---------- assembly: Python ----------
from climate_active_envelopes.assembly import CAEAssembly as Assembly

#create empty assembly
my_assembly = Assembly()
# ---------- end assembly ----------

# ----
# Unload Python modules
unload = Python3Script(unload=button)  # -> out, a
# ---------- unload: Python ----------
from compas_ghpython import unload_modules

unload_modules('climate_active_envelopes')
unload_modules('assembly_information_model')
# ---------- end unload ----------

# ----
# Slicing mesh input
contour = Python3Script(brep=sd_input_geometry, layer_height=layer_height)  # -> out, curves; inputs brep: Mesh, layer_height: Double
# ---------- contour: Python ----------
import Rhino.Geometry as rg

mesh = brep

vertices = mesh.Vertices
pt_base = vertices[0]
pt_end = vertices[2]
print(pt_end)

pt_base = vertices[0]
pt_end = vertices[1]


start_plane = rg.Plane(pt_base, rg.Vector3d(0, 0, 1))
end_plane = rg.Plane(pt_end, rg.Vector3d(0, 0, 1))

curves =rg.Mesh.CreateContourCurves(mesh, pt_base,  pt_end, layer_height)
# ---------- end contour ----------
crv = Curve(contour.curves)

# ----
# Create brick assembly
list_2 = ValueList({"flemish_bond": 0}, selected="flemish_bond")
create_assembly = Python3Script(
    bond=list_2,
    my_assembly=assembly.my_assembly,
    brick_full=part.full_brick,
    brick_insulated=part.insulated_brick,
    plane=pln,
    lines=contour.curves)  # -> out, my_assembly, total_length; inputs plane: Plane, lines: list of Line
# ---------- create_assembly: Python ----------
total_length = my_assembly.generate_wall(bond,
                        brick_full, 
                        brick_insulated,
                        plane,
                        lines
                        )
# ---------- end create_assembly ----------
total_length_2 = Panel(create_assembly.total_length)

# ----
# Apply Gradient
button_2 = Button()
list_3 = ValueList({"rotate", "translate"}, selected="rotate")
get_centroids = Python3Script(my_assembly=create_assembly.my_assembly, transform_type=list_3)  # -> out, my_assembly, keys; inputs transform_type: String
# ---------- get_centroids: Python ----------
from compas.geometry import Frame, Translation, Rotation, Transformation, Point
from compas_rhino.conversions import plane_to_compas_frame, point_to_compas

import math
import Rhino.Geometry as rg

values = []
keys = []


for key in my_assembly.graph.nodes_where({"transform_type": transform_type}):
    part = my_assembly.part(key)
    keys.append(key)

my_assembly = my_assembly
# ---------- end get_centroids ----------
panel = Panel("""0.181727
0.193151
0.193151
0.193151
0.343663
0.248775
0.265926
0.250045
0.250045
0.238421
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""")
apply_gradient = Python3Script(
    my_assembly=create_assembly.my_assembly,
    values=panel,
    keys=get_centroids.keys,
    transform_type=list_3,
    transform=button_2)  # -> out, my_assembly; inputs values: list of Double, keys: list
# ---------- apply_gradient: Python ----------
import math
import Rhino.Geometry as rg
from compas.geometry import Frame, Point
from compas.geometry import Transformation, Rotation, Translation


#print(my_assembly.apply_gradient(values, keys, transform_type_))


#print(my_assembly.__data__)

#transform_types = {node_id: my_assembly.graph.node_attribute(node_id, 'transform_type') for node_id in my_assembly.graph.nodes()}




if transform:
    assembly = my_assembly
    my_assembly.apply_gradient(values, keys, transform_type)

    #print(test)
# ---------- end apply_gradient ----------

# ---- group: ignore
list_4 = ValueList({"show all": "show_all", "show until key": "show_until_key", "show nothing": "show_nothing"}, selected="show all")

# ----
# Visualisation Dashboard
toggle = BooleanToggle(False)
visualize = Python3Script(my_assembly=apply_gradient.my_assembly, show=list_4, highlight_current_part=toggle)  # -> out, parts_geometry
# ---------- visualize: Python ----------
from compas_rhino.conversions import mesh_to_rhino, box_to_rhino, frame_to_rhino

#print assembly
print(my_assembly)
#counter = int(counter)

#get parts datastructure
parts = [p for p in my_assembly.parts()]

#get current part

#if show_wall == True:

if show == "show_all":
    
#get parts datastructure
    parts = [p for p in my_assembly.parts()]
    parts_geometry = []
    parts_frame = []

    #part = parts[0]
    #print(part.gripping_frame)

    #extract the mesh of the parts for visulization (+ converted to rhino mesh)
    parts_geometry = [mesh_to_rhino(p.mesh) for p in parts]
    
    #extract the frame of the parts for visulization (+ converted to rhino plane)
    parts_frame = [frame_to_rhino(p.frame) for p in parts]
    #print(parts_geometry)

    key = my_assembly.graph.number_of_nodes()-1

if show == "show_until_key":
    #extract the mesh of the parts for visulization (+ converted to rhino mesh)
    parts_geometry = [mesh_to_rhino(p.mesh) for p in parts[0:int(counter)]]
    
    #extract the frame of the parts for visulization (+ converted to rhino plane)
    parts_frame = [frame_to_rhino(p.frame) for p in parts[0:int(counter)]]

    key = int(counter)-1

if show == "show_nothing":
    print("Nothing to see")
    pass

if highlight_current_part:
    current_part = my_assembly.part(key)
    current_part_geometry = mesh_to_rhino(current_part.mesh)
    current_part_frame = frame_to_rhino(current_part.frame)
    current_part_gripping_frame = frame_to_rhino(current_part.gripping_frame)
    
    print(current_part.__data__)
# ---------- end visualize ----------
geo = Geometry(visualize.parts_geometry)
preview = CustomPreview(Geometry=geo, Material=ColourSwatch(SwatchColor=RGB(196, 141, 141)))
